# Grasshopper definition 533Week2Grasshopper.gh (Grasshopper 1.0.8)

horizontal_sections = Slider(9, range=1..30)
thickness_of_element = Slider(0.125, range=0..1)
pattern_surface = Geometry(<surface referenced from the Rhino model>)
verticle_sections = Slider(12, range=1..30)
bounding_box_around_pattern_surface = Geometry(<extrusion referenced from the Rhino model>)
surface_to_pattern_on_to = Surface(<surface referenced from the Rhino model>)

unit_z = UnitZ(Factor=thickness_of_element)
extrude = Extrude(Base=pattern_surface, Direction=unit_z)
cap_holes = CapHoles(Brep=extrude)
divide_domain² = DivideDomain²(Domain=surface_to_pattern_on_to, UCount=verticle_sections, VCount=horizontal_sections)
surface_box = SurfaceBox(Surface=surface_to_pattern_on_to, Domain=divide_domain², Height=0.1)

bake_this = BoxMorph(Geometry=cap_holes, Reference=bounding_box_around_pattern_surface, Target=surface_box)
